# Grasshopper definition calcite.gh (Grasshopper 0.9.76)

panel = Panel("2.566")

# ----
# MASTER SWITCH
# original: false
# abstract: true
# circles: false
# Sticks: true
# outside circles
# abstract control
shape_scale = Slider(0.618, range=0..1)
# overall size
bond_length_scale = Slider(0.803, range=0..2)
outside_core = Slider(0.32, range=0.1..1)
sphere_radius = Slider(0.183, range=0..0.5)
pipe_length = Slider(1.032, range=0..2)
inside_core = Slider(0.63, range=0.1..1)
# original control
pipe_radius = Slider(0.057, range=0..0.5)
toggle = BooleanToggle(False)
toggle_2 = BooleanToggle(True)
right_shift = Slider(-0.757, range=-3..3)
toggle_3 = BooleanToggle(True)
# core shifts
left_shift = Slider(1.09, range=-3..3)

X = UnitX(Factor=1)
multiplication = Multiplication(A="1.283", B=2)
neg = Negative(Value="1.283")
line = LineSDL(Start="0,0,0", Direction=X, Length=multiplication)
X_2 = UnitX(Factor=neg)
xz = XZPlane(Origin=Point(0, 0, 0))
xy = XYPlane(Origin=Point(0, 0, 0))
rad = Radians(Degrees=90)
move = Move(Geometry=line, Motion=X_2)  # -> Geometry, Transform
rotate = Rotate(Geometry=move.Geometry, Angle=rad, Plane=xy)  # -> Geometry, Transform
rotate_2 = Rotate(Geometry=move.Geometry, Angle=rad, Plane=xz)  # -> Geometry, Transform
merge = Merge(Data1=move.Geometry, Data2=rotate_2.Geometry, Data3=rotate.Geometry)
Z = UnitZ(Factor=1)
Y = UnitY(Factor=1)
X_3 = UnitX(Factor=1)
pipe = Pipe(Curve=merge, Radius=pipe_radius, Caps=0)
rad_2 = Radians(Degrees=Slider(0, range=0..360))
rad_3 = Radians(Degrees=Slider(0, range=0..360))
rad_4 = Radians(Degrees=Slider(0, range=0..360))
rot3d = Rotate3D(Geometry=pipe, Angle=rad_2, Center=Point(0, 0, 0), Axis=Z)  # -> Geometry, Transform
rot3d_2 = Rotate3D(Geometry=rot3d.Geometry, Angle=rad_3, Center=Point(0, 0, 0), Axis=X_3)  # -> Geometry, Transform
rot3d_3 = Rotate3D(Geometry=rot3d_2.Geometry, Angle=rad_4, Center=Point(0, 0, 0), Axis=Y)  # -> Geometry, Transform

crv = Curve([<curve referenced from the Rhino model> x35])
pipe_2 = Pipe(Curve=crv, Radius=pipe_radius, Caps=0)
panel_2 = Panel(pipe_radius)

# ----
# core
multiplication_2 = Multiplication(A=panel_2, B=3)
neg_2 = Negative(Value=multiplication_2)
Z_2 = UnitZ(Factor=multiplication_2)
cir = Circle(Plane=PlaneXY(0, 0, 0), Radius=inside_core)
division = Division(A=neg_2, B=2)
extr = Extrude(Base=cir, Direction=Z_2)
Z_3 = UnitZ(Factor=division)
cap = CapHoles(Brep=extr)
pipe_3 = Pipe(Curve=cir, Radius=panel_2, Caps=0)
move_2 = Move(Geometry=cap, Motion=Z_3)  # -> Geometry, Transform

geo = Geometry(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)
geo_2 = Geometry(<brep referenced from the Rhino model>)
srf = Surface(<surface referenced from the Rhino model>)
scale = Scale(Geometry=geo, Center=Point(0, 0, 0), Factor=bond_length_scale)  # -> Geometry, Transform
# POINTS MAIN
scale_2 = Scale(Geometry=geo_2, Center=Point(0, 0, 0), Factor=shape_scale)  # -> Geometry, Transform
scale_3 = Scale(Geometry=srf, Center=Point(0, 0, 0), Factor=shape_scale)  # -> Geometry, Transform
divide = DivideDomain²(Domain=scale_3.Geometry, UCount=3, VCount=1)
# CLUSTERS MAIN
rotate_3 = Rotate(Geometry=scale.Geometry, Angle=1.570796327, Plane=PlaneXY(0, 0, 0))  # -> Geometry, Transform
subsrf = Isotrim(Surface=scale_3.Geometry, Domain=divide)
disc = Discontinuity(Curve=rotate_3.Geometry, Level=1)  # -> Points, Parameters
item = ListItem(List=subsrf, Index=1, Wrap=True)
outside = DeconstructBrep(Brep=scale_2.Geometry)  # -> Faces, Edges, Vertices
internal = DeconstructBrep(Brep=item)  # -> Faces, Edges, Vertices
area = Area(Geometry=rotate_3.Geometry)  # -> Area, Centroid
# find points
list_item = ListItem(List=disc.Points, Index=0, Wrap=True)
list_item_2 = ListItem(List=disc.Points, Index=1, Wrap=True)
list_item_3 = ListItem(List=disc.Points, Index=2, Wrap=True)
X_4 = UnitX(Factor=1)
# divide shape
# into lines
bottom = ListItem(List=outside.Edges, Index=5, Wrap=True)
left = ListItem(List=outside.Edges, Index=1, Wrap=True)
top = ListItem(List=outside.Edges, Index=3, Wrap=True)
right = ListItem(List=outside.Edges, Index=8, Wrap=True)
left_2 = ListItem(List=internal.Edges, Index=3, Wrap=True)
right_2 = ListItem(List=internal.Edges, Index=1, Wrap=True)
line_2 = LineSDL(Start=Point(0, 0, 0), Direction=X_4, Length=pipe_length)

# ----
# NEW SINGLE SHAPES
rad_5 = Radians(Degrees=30)
rotate_4 = Rotate(Geometry=line_2, Angle=rad_5, Plane=PlaneXY(0, 0, 0))  # -> Geometry, Transform
pipe_4 = Pipe(Curve=rotate_4.Geometry, Radius=panel_2, Caps=0)
sdiff = SolidDifference(BrepsA=pipe_4, BrepsB=move_2.Geometry)
cap_2 = CapHoles(Brep=sdiff)
sunion = SolidUnion(Breps=[cap_2, pipe_3])

# ----
# NEW DOUBLE SHAPES
rad_6 = Radians(Degrees=240)
arrpolar = PolarArray(Geometry=line_2, Plane=PlaneXY(0, 0, 0), Count=2, Angle=rad_6)  # -> Geometry, Transform
rad_7 = Radians(Degrees=30)
rotate_5 = Rotate(Geometry=arrpolar.Geometry, Angle=rad_7, Plane=PlaneXY(0, 0, 0))  # -> Geometry, Transform
pipe_5 = Pipe(Curve=rotate_5.Geometry, Radius=panel_2, Caps=0)
sunion_2 = SolidUnion(Breps=pipe_5)
sdiff_2 = SolidDifference(BrepsA=sunion_2, BrepsB=move_2.Geometry)
cap_3 = CapHoles(Brep=sdiff_2)
sunion_3 = SolidUnion(Breps=[cap_3, pipe_3])

arrpolar_2 = PolarArray(Geometry=line_2, Plane=PlaneXY(0, 0, 0), Count=3, Angle=6.283185307)  # -> Geometry, Transform
create_list = DivideCurve(Curve=left_2, Count=4, Kinks=False)  # -> Points, Tangents, Parameters
create_list_2 = DivideCurve(Curve=right_2, Count=4, Kinks=False)  # -> Points, Tangents, Parameters
rad_8 = Radians(Degrees=270)

# ----
# core lines
ln = Line(StartPoint=list_item, EndPoint=area.Centroid)
ln_2 = Line(StartPoint=list_item_2, EndPoint=area.Centroid)
ln_3 = Line(StartPoint=list_item_3, EndPoint=area.Centroid)

rotate_6 = Rotate(Geometry=arrpolar_2.Geometry, Angle=rad_8, Plane=PlaneXY(0, 0, 0))  # -> Geometry, Transform
_1_5_1_9 = DivideCurve(Curve=left, Count=4, Kinks=False)  # -> Points, Tangents, Parameters
_2_0_2_3 = SubList(List=create_list.Points, Domain=Domain(0, 3), Wrap=True)  # -> List, Index
_1_15_1_9 = DivideCurve(Curve=right, Count=4, Kinks=False)  # -> Points, Tangents, Parameters
_1_10_1_14 = DivideCurve(Curve=top, Count=4, Kinks=False)  # -> Points, Tangents, Parameters
_2_4_2_7 = SubList(List=create_list_2.Points, Domain=Domain(0, 3), Wrap=True)  # -> List, Index
# points sequence:
# 
# 3 groups:
# 
# 1 - external points
# 2- internal points
# 3- cluster config
# find points
_1_0_1_4 = DivideCurve(Curve=bottom, Count=4, Kinks=False)  # -> Points, Tangents, Parameters
pipe_6 = Pipe(Curve=rotate_6.Geometry, Radius=panel_2, Caps=0)
subset = SubList(List=_1_15_1_9.Points, Domain=Domain(2, 4), Wrap=True)  # -> List, Index
sunion_4 = SolidUnion(Breps=pipe_6)
# Molecule
# shapes
pipe_7 = Pipe(Curve=ln, Radius=pipe_radius, Caps=0)
pipe_8 = Pipe(Curve=ln_3, Radius=pipe_radius, Caps=0)
pipe_9 = Pipe(Curve=ln_2, Radius=pipe_radius, Caps=0)
sph = Sphere(Base=area.Centroid, Radius=sphere_radius)
sph_2 = Sphere(Base=disc.Points, Radius=sphere_radius)
Z_4 = UnitZ(Factor=left_shift)
Z_5 = UnitZ(Factor=right_shift)
sdiff_3 = SolidDifference(BrepsA=sunion_4, BrepsB=move_2.Geometry)

# ----
# inside shifting
move_3 = Move(Geometry=_2_0_2_3.List, Motion=Z_4)  # -> Geometry, Transform
move_4 = Move(Geometry=_2_4_2_7.List, Motion=Z_5)  # -> Geometry, Transform

cap_4 = CapHoles(Brep=sdiff_3)
list_item_4 = ListItem(List=_1_10_1_14.Points, Index=2, Wrap=True)
list_item_5 = ListItem(List=_1_15_1_9.Points, Index=4, Wrap=True)
# separate points
# into categories
list_item_6 = ListItem(List=_1_0_1_4.Points, Index=0, Wrap=True)
_2_1_2_3 = CullPattern(List=move_3.Geometry, CullPattern=[False, True])
_2_4_2_6 = CullPattern(List=move_4.Geometry, CullPattern=[False, True])
list_item_7 = ListItem(List=sph_2, Index=2, Wrap=True)
list_item_8 = ListItem(List=sph_2, Index=1, Wrap=True)
cull = CullPattern(List=move_4.Geometry, CullPattern=[True, False])
cull_2 = CullPattern(List=move_3.Geometry, CullPattern=[True, False])

# ----
# NEW CLUSTER SHAPES
sunion_5 = SolidUnion(Breps=[pipe_3, cap_4])

list_item_9 = ListItem(List=_1_0_1_4.Points, Index=1, Wrap=True)
list_item_10 = ListItem(List=_1_5_1_9.Points, Index=3, Wrap=True)
list_item_11 = ListItem(List=_1_10_1_14.Points, Index=3, Wrap=True)
list_item_12 = ListItem(List=_1_15_1_9.Points, Index=3, Wrap=True)
list_item_13 = ListItem(List=_1_10_1_14.Points, Index=1, Wrap=True)
list_item_14 = ListItem(List=cull_2, Index=0, Wrap=True)
list_item_15 = ListItem(List=cull_2, Index=1, Wrap=True)
list_item_16 = ListItem(List=cull, Index=1, Wrap=True)
list_item_17 = ListItem(List=cull, Index=0, Wrap=True)
# single atoms
merge_2 = Merge(Data1=list_item_6, Data2=list_item_4, Data4=list_item_5, Data5=_2_1_2_3, Data6=_2_4_2_6)  # -> flatten(Result)

# ----
# molecule types
# cluster : 3A
out = SolidUnion(Breps=[pipe_7, pipe_8, pipe_9, sph_2])
mid = SolidUnion(Breps=sph)

# ----
# DOUBLE : 3B
side1 = SolidUnion(Breps=[pipe_8, list_item_7])
mid_2 = SolidUnion(Breps=sph)
side2 = SolidUnion(Breps=[pipe_9, list_item_8])

# ----
# SINGLE : 3C
side2_2 = SolidUnion(Breps=[pipe_9, list_item_8])
mid_3 = SolidUnion(Breps=sph)

merge_3 = Merge(Data1=side1, Data2=side2)
multiplication_3 = Multiplication(A=sphere_radius, B=1.5)

# ----
# CORE SWITCH
# original
# change me
sph_3 = Sphere(Base=merge_2, Radius=multiplication_3)
sph_4 = Sphere(Base=merge_2, Radius=multiplication_3)

# ----
# MOVEMENT
pt = Point(list_item_14)
pt_2 = Point(list_item_15)
pt_3 = Point(list_item_17)
pt_4 = Point(list_item_16)
pt_5 = Point(list_item_12)
pt_6 = Point(list_item_10)
pt_7 = Point(list_item_9)
pt_8 = Point(list_item_13)
pt_9 = Point(list_item_11)
rad_9 = Radians(Degrees=60)
rad_10 = Radians(Degrees=180)
rad_11 = Radians(Degrees=60)
rad_12 = Radians(Degrees=180)
rad_13 = Radians(Degrees=120)
rad_14 = Radians(Degrees=120)
rad_15 = Radians(Degrees=60)
rad_16 = Radians(Degrees=240)
rad_17 = Radians(Degrees=240)
rad_18 = Radians(Degrees=180)
rad_19 = Radians(Degrees=180)
Z_6 = UnitZ(Factor=1)

Y_2 = UnitY(Factor=1)
Y_3 = UnitY(Factor=1)

Z_7 = UnitZ(Factor=1)
Z_8 = UnitZ(Factor=1)
Z_9 = UnitZ(Factor=1)
Z_10 = UnitZ(Factor=1)
Z_11 = UnitZ(Factor=1)
Z_12 = UnitZ(Factor=1)
Z_13 = UnitZ(Factor=1)
Z_14 = UnitZ(Factor=1)
Z_15 = UnitZ(Factor=1)
rad_20 = Radians(Degrees=60)

end = EndPoints(Curve=rotate_4.Geometry)  # -> Start, End
multiplication_4 = Multiplication(A=panel_2, B=3)
neg_3 = Negative(Value=multiplication_4)
Z_16 = UnitZ(Factor=multiplication_4)
cir_2 = Circle(Plane=end.End, Radius=outside_core)
division_2 = Division(A=neg_3, B=2)
extr_2 = Extrude(Base=cir_2, Direction=Z_16)
Z_17 = UnitZ(Factor=division_2)
cap_5 = CapHoles(Brep=extr_2)
pipe_10 = Pipe(Curve=cir_2, Radius=panel_2, Caps=0)
move_5 = Move(Geometry=cap_5, Motion=Z_17)  # -> Geometry, Transform
sdiff_4 = SolidDifference(BrepsA=pipe_4, BrepsB=move_5.Geometry)
gate = StreamGate(Stream=sunion, Gate=toggle)  # -> Target0, Target1

sdiff_5 = SolidDifference(BrepsA=sdiff_4, BrepsB=move_2.Geometry)

end_2 = EndPoints(Curve=rotate_5.Geometry)  # -> Start, End
multiplication_5 = Multiplication(A=panel_2, B=3)
neg_4 = Negative(Value=multiplication_5)
Z_18 = UnitZ(Factor=multiplication_5)
cir_3 = Circle(Plane=end_2.End, Radius=outside_core)
division_3 = Division(A=neg_4, B=2)
extr_3 = Extrude(Base=cir_3, Direction=Z_18)
Z_19 = UnitZ(Factor=division_3)
cap_6 = CapHoles(Brep=extr_3)
move_6 = Move(Geometry=cap_6, Motion=Z_19)  # -> Geometry, Transform
pipe_11 = Pipe(Curve=cir_3, Radius=panel_2, Caps=0)
sdiff_6 = SolidDifference(BrepsA=pipe_5, BrepsB=move_6.Geometry)
gate_2 = StreamGate(Stream=sunion_3, Gate=toggle)  # -> Target0, Target1

sdiff_7 = SolidDifference(BrepsA=sdiff_6, BrepsB=move_2.Geometry)

multiplication_6 = Multiplication(A=panel_2, B=3)
end_3 = EndPoints(Curve=rotate_4.Geometry)  # -> Start, End
neg_5 = Negative(Value=multiplication_6)
Z_20 = UnitZ(Factor=multiplication_6)
cir_4 = Circle(Plane=end_3.End, Radius=outside_core)
division_4 = Division(A=neg_5, B=2)
extr_4 = Extrude(Base=cir_4, Direction=Z_20)
Z_21 = UnitZ(Factor=division_4)
cap_7 = CapHoles(Brep=extr_4)
pipe_12 = Pipe(Curve=cir_4, Radius=panel_2, Caps=0)
move_7 = Move(Geometry=cap_7, Motion=Z_21)  # -> Geometry, Transform
sdiff_8 = SolidDifference(BrepsA=pipe_4, BrepsB=move_7.Geometry)
gate_3 = StreamGate(Stream=cap_2, Gate=toggle)  # -> Target0, Target1

sdiff_9 = SolidDifference(BrepsA=sdiff_8, BrepsB=move_2.Geometry)

end_4 = EndPoints(Curve=rotate_6.Geometry)  # -> Start, End
multiplication_7 = Multiplication(A=panel_2, B=3)
neg_6 = Negative(Value=multiplication_7)
Z_22 = UnitZ(Factor=multiplication_7)
cir_5 = Circle(Plane=end_4.End, Radius=outside_core)
division_5 = Division(A=neg_6, B=2)
extr_5 = Extrude(Base=cir_5, Direction=Z_22)
Z_23 = UnitZ(Factor=division_5)
cap_8 = CapHoles(Brep=extr_5)
move_8 = Move(Geometry=cap_8, Motion=Z_23)  # -> Geometry, Transform
sdiff_10 = SolidDifference(BrepsA=pipe_6, BrepsB=move_8.Geometry)
pipe_13 = Pipe(Curve=cir_5, Radius=panel_2, Caps=0)
gate_4 = StreamGate(Stream=sunion_5, Gate=toggle)  # -> Target0, Target1

sdiff_11 = SolidDifference(BrepsA=sdiff_10, BrepsB=move_2.Geometry)
merge_4 = Merge(Data1=pipe_13, Data2=sdiff_11, Data3=pipe_3)

gate_5 = StreamGate(Stream=merge_4, Gate=toggle)  # -> Target0, Target1
merge_5 = Merge(Data1=gate_4.Target0, Data2=gate_5.Target1)

sunion_6 = SolidUnion(Breps=[pipe_10, sdiff_5])

merge_6 = Merge(Data1=pipe_3, Data2=sunion_6)

gate_6 = StreamGate(Stream=merge_6, Gate=toggle)  # -> Target0, Target1
merge_7 = Merge(Data1=gate.Target0, Data2=gate_6.Target1)

sunion_7 = SolidUnion(Breps=[pipe_11, sdiff_7])

merge_8 = Merge(Data1=pipe_3, Data2=sunion_7)

gate_7 = StreamGate(Stream=merge_8, Gate=toggle)  # -> Target0, Target1
merge_9 = Merge(Data1=gate_2.Target0, Data2=gate_7.Target1)

sunion_8 = SolidUnion(Breps=[sdiff_9, pipe_12])

merge_10 = Merge(Data1=pipe_3, Data2=sunion_8)

gate_8 = StreamGate(Stream=merge_10, Gate=toggle)  # -> Target0, Target1
merge_11 = Merge(Data1=gate_3.Target0, Data2=gate_8.Target1)

gate_9 = StreamGate(Stream=merge_11, Gate=toggle_2)  # -> Target0, Target1
gate_10 = StreamGate(Stream=pipe_4, Gate=toggle_2)  # -> Target0, Target1
merge_12 = Merge(Data1=gate_9.Target0, Data2=gate_10.Target1)
gate_11 = StreamGate(Stream=merge_12, Gate=toggle_3)  # -> Target0, Target1

gate_12 = StreamGate(Stream=merge_5, Gate=toggle_2)  # -> Target0, Target1
gate_13 = StreamGate(Stream=sunion_4, Gate=toggle_2)  # -> Target0, Target1
gate_14 = StreamGate(Stream=merge_9, Gate=toggle_2)  # -> Target0, Target1
gate_15 = StreamGate(Stream=sunion_2, Gate=toggle_2)  # -> Target0, Target1
gate_16 = StreamGate(Stream=merge_7, Gate=toggle_2)  # -> Target0, Target1
gate_17 = StreamGate(Stream=pipe_4, Gate=toggle_2)  # -> Target0, Target1
merge_13 = Merge(Data1=gate_12.Target0, Data2=gate_13.Target1)
merge_14 = Merge(Data1=gate_14.Target0, Data2=gate_15.Target1)
merge_15 = Merge(Data1=gate_16.Target0, Data2=gate_17.Target1)
# SWITCH LOGIC
gate_18 = StreamGate(Stream=sph_3, Gate=toggle_3)  # -> Target0, Target1
gate_19 = StreamGate(Stream=sph_4, Gate=toggle_3)  # -> Target0, Target1
gate_20 = StreamGate(Stream=mid_3, Gate=toggle_3)  # -> Target0, Target1
gate_21 = StreamGate(Stream=merge_15, Gate=toggle_3)  # -> Target0, Target1
gate_22 = StreamGate(Stream=mid_2, Gate=toggle_3)  # -> Target0, Target1
gate_23 = StreamGate(Stream=merge_14, Gate=toggle_3)  # -> Target0, Target1
gate_24 = StreamGate(Stream=merge_3, Gate=toggle_3)  # -> Target0, Target1
gate_25 = StreamGate(Stream=out, Gate=toggle_3)  # -> Target0, Target1
gate_26 = StreamGate(Stream=merge_13, Gate=toggle_3)  # -> Target0, Target1
gate_27 = StreamGate(Stream=mid, Gate=toggle_3)  # -> Target0, Target1
gate_28 = StreamGate(Stream=side2_2, Gate=toggle_3)  # -> Target0, Target1
merge_16 = Merge(Data1=gate_28.Target0, Data2=gate_11.Target1)
merge_17 = Merge(Data1=gate_18.Target0, Data2=gate_19.Target1)
merge_18 = Merge(Data1=gate_20.Target0, Data2=gate_21.Target1)
merge_19 = Merge(Data1=gate_22.Target0, Data2=gate_23.Target1)
merge_20 = Merge(Data1=gate_24.Target0)
merge_21 = Merge(Data1=gate_25.Target0, Data2=gate_26.Target1)
merge_22 = Merge(Data1=gate_27.Target0)

move_9 = Move(Geometry=merge_21, Motion=pt_2)  # -> Geometry, Transform
move_10 = Move(Geometry=merge_22, Motion=pt_2)  # -> Geometry, Transform
move_11 = Move(Geometry=merge_21, Motion=pt_3)  # -> Geometry, Transform
move_12 = Move(Geometry=merge_22, Motion=pt_3)  # -> Geometry, Transform
move_13 = Move(Geometry=merge_16, Motion=pt_5)  # -> Geometry, Transform
move_14 = Move(Geometry=merge_18, Motion=pt_5)  # -> Geometry, Transform
move_15 = Move(Geometry=merge_16, Motion=pt_7)  # -> Geometry, Transform
move_16 = Move(Geometry=merge_18, Motion=pt_7)  # -> Geometry, Transform
move_17 = Move(Geometry=merge_16, Motion=pt_8)  # -> Geometry, Transform
move_18 = Move(Geometry=merge_18, Motion=pt_8)  # -> Geometry, Transform
move_19 = Move(Geometry=merge_20, Motion=pt_9)  # -> Geometry, Transform
move_20 = Move(Geometry=merge_19, Motion=pt_9)  # -> Geometry, Transform

# ----
# 3A
# 3C
# 3B
center = Move(Geometry=merge_22, Motion=pt_4)  # -> Geometry, Transform
_2_1_3a = Move(Geometry=merge_21, Motion=pt)  # -> Geometry, Transform
center_2 = Move(Geometry=merge_22, Motion=pt)  # -> Geometry, Transform
_2_2_3a = Rotate3D(Geometry=move_9.Geometry, Angle=rad_9, Center=pt_2, Axis=Z_6)  # -> Geometry, Transform
center_3 = Rotate3D(Geometry=move_10.Geometry, Angle=rad_10, Center=pt_2, Axis=Y_2)  # -> Geometry, Transform
_2_7_3a = Rotate3D(Geometry=move_11.Geometry, Angle=rad_11, Center=pt_3, Axis=Z_7)  # -> Geometry, Transform
center_4 = Rotate3D(Geometry=move_12.Geometry, Angle=rad_12, Center=pt_3, Axis=Y_3)  # -> Geometry, Transform
_1_18_3c = Rotate3D(Geometry=move_13.Geometry, Angle=rad_13, Center=pt_5, Axis=Z_8)  # -> Geometry, Transform
center_5 = Rotate3D(Geometry=move_14.Geometry, Angle=rad_14, Center=pt_5, Axis=Z_9)  # -> Geometry, Transform; disabled
center_6 = Move(Geometry=merge_18, Motion=pt_6)  # -> Geometry, Transform; disabled
_1_1_3c = Rotate3D(Geometry=move_15.Geometry, Angle=rad_20, Center=pt_7, Axis=Z_10)  # -> Geometry, Transform
center_7 = Rotate3D(Geometry=move_16.Geometry, Angle=rad_15, Center=pt_7, Axis=Z_11)  # -> Geometry, Transform; disabled
_1_11_3c = Rotate3D(Geometry=move_17.Geometry, Angle=rad_16, Center=pt_8, Axis=Z_12)  # -> Geometry, Transform
center_8 = Rotate3D(Geometry=move_18.Geometry, Angle=rad_17, Center=pt_8, Axis=Z_13)  # -> Geometry, Transform
_1_13_3b = Rotate3D(Geometry=move_19.Geometry, Angle=rad_18, Center=pt_9, Axis=Z_14)  # -> Geometry, Transform
center_9 = Rotate3D(Geometry=move_20.Geometry, Angle=rad_19, Center=pt_9, Axis=Z_15)  # -> Geometry, Transform
_2_5_3a = Move(Geometry=merge_21, Motion=pt_4)  # -> Geometry, Transform
_1_8_3c = Move(Geometry=merge_16, Motion=pt_6)  # -> Geometry, Transform
geo_3 = Geometry(merge_17)

volume = Volume(Geometry=_2_2_3a.Geometry)  # -> Volume, flatten(Centroid)
volume_2 = Volume(Geometry=_1_18_3c.Geometry)  # -> Volume, flatten(Centroid)
item_2 = ListItem(List=volume.Centroid, Index=0, Wrap=True)
item_3 = ListItem(List=volume_2.Centroid, Index=0, Wrap=True)
ln_4 = Line(StartPoint=item_2, EndPoint=item_3)
len = Length(Curve=ln_4)
panel_3 = Panel(len)
merge_23 = Merge(
    Data1=_2_1_3a.Geometry,
    Data2=_2_2_3a.Geometry,
    Data3=_2_7_3a.Geometry,
    Data4=_2_5_3a.Geometry,
    Data5=_1_18_3c.Geometry,
    Data6=_1_8_3c.Geometry,
    Data7=_1_1_3c.Geometry,
    Data8=_1_11_3c.Geometry,
    Data9=_1_13_3b.Geometry,
    Data10=geo_3)
