# Grasshopper definition fractals.gh (Grasshopper 0.9.76)

number_slider = Slider(3, range=3..10)
number_slider_2 = Slider(10, range=0..10)
polygon = Polygon(Plane=PlaneXY(0, 0, 0), Radius=number_slider_2, Segments=number_slider, FilletRadius=0)  # -> Polygon, Length
# rotation
number_slider_3 = Slider(250, range=0..360)
how_many_shapes_along_curve = Slider(1, range=0..10)
# spacing
number_slider_4 = Slider(-32, range=-100..0)
# shapes
how_big = Slider(9, range=0..10)
of_sides = Slider(4, range=3..10)
discontinuity = Discontinuity(Curve=polygon.Polygon, Level=1)  # -> Points, Parameters
multiplication = Multiplication(A=number_slider_2, B=Slider(3.46, range=0..10))
unit_y = UnitY(Factor=multiplication)
polygon_2 = Polygon(Plane=PlaneXY(0, 0, 0), Radius=how_big, Segments=of_sides, FilletRadius=0)  # -> Polygon, Length
discontinuity_2 = Discontinuity(Curve=polygon_2.Polygon, Level=1)  # -> Points, Parameters
multiplication_2 = Multiplication(A=number_slider_2, B=Slider(1.728, range=0..10))
unit_y_2 = UnitY(Factor=multiplication_2)
shift_list = ShiftList(List=discontinuity_2.Points, Shift=1, Wrap=True)
multiplication_3 = Multiplication(A=number_slider_2, B=Slider(3.002, range=0..10))
line = Line(StartPoint=discontinuity_2.Points, EndPoint=shift_list)
unit_x = UnitX(Factor=multiplication_3)
divide_curve = DivideCurve(Curve=line, Count=how_many_shapes_along_curve, Kinks=False)  # -> Points, Tangents, Parameters
panel = Panel(divide_curve.Points)
cull_pattern = CullPattern(List=panel, CullPattern=[False, True, False])
polygon_3 = Polygon(Plane=discontinuity.Points, Radius=Slider(10, range=0..10), Segments=number_slider, FilletRadius=0)  # -> Polygon, Length
move = Move(Geometry=polygon_3.Polygon, Motion=unit_y_2)  # -> Geometry, Transform
move_2 = Move(Geometry=polygon_3.Polygon, Motion=unit_y)  # -> Geometry, Transform
move_3 = Move(Geometry=move.Geometry, Motion=unit_x)  # -> Geometry, Transform
panel_2 = Panel(cull_pattern)
merge = Merge(Data1=move_3.Geometry, Data2=polygon_3.Polygon, Data3=move_2.Geometry)
discontinuity_3 = Discontinuity(Curve=merge, Level=1)  # -> Points, Parameters
curve = Curve(<curve referenced from the Rhino model>)
division = Division(A=how_big, B=2)
curve_closest_point = CurveClosestPoint(Point=discontinuity_3.Points, Curve=curve)  # -> Point, Parameter, Distance
polygon_4 = Polygon(Plane=panel_2, Radius=division, Segments=of_sides, FilletRadius=0)  # -> Polygon, Length
line_2 = Line(StartPoint=discontinuity_3.Points, EndPoint=curve_closest_point.Point)
series = Series(Start="60", Step="60", Count="3")
panel_3 = Panel(line_2)
area = Area(Geometry=polygon_4.Polygon)  # -> Area, Centroid
plane_normal = PlaneNormal(Origin=Point(0, 0, 0), ZAxis=Vector(0, 0, 1))
radians = Radians(Degrees=Slider(217, range=0..360))
radians_2 = Radians(Degrees=number_slider_3)
rotate = Rotate(Geometry=polygon_4.Polygon, Angle=radians_2, Plane=area.Centroid)  # -> flatten(Geometry), Transform
merge_2 = Merge(Data1=polygon_2.Polygon, Data2=rotate.Geometry, Data3=polygon_4.Polygon)
rotate_2 = Rotate(Geometry=merge_2, Angle=radians, Plane=plane_normal)  # -> Geometry, Transform
unit_x_2 = UnitX(Factor=number_slider_4)
move_4 = Move(Geometry=[rotate_2.Geometry, merge_2], Motion=unit_x_2)  # -> Geometry, Transform
