# Grasshopper definition grid.gh (Grasshopper 0.9.76)

number_slider = Slider(11, range=1..20)
box = CenterBox(Base=PlaneXY(0, 0, 0), X=number_slider, Y=number_slider, Z=number_slider)
debrep = DeconstructBrep(Brep=box)  # -> Faces, Edges, Vertices
item = ListItem(List=debrep.Faces, Index=Slider(0, range=0..5), Wrap=True)
item_2 = ListItem(List=debrep.Faces, Index=Slider(1, range=0..5), Wrap=True)
item_3 = ListItem(List=debrep.Faces, Index=Slider(5, range=0..5), Wrap=True)
divide = DivideDomain²(Domain=item, UCount=2, VCount=2)
divide_2 = DivideDomain²(Domain=item_2, UCount=2, VCount=2)
divide_3 = DivideDomain²(Domain=item_3, UCount=2, VCount=2)
subsrf = Isotrim(Surface=item, Domain=divide)
subsrf_2 = Isotrim(Surface=item_2, Domain=divide_2)
subsrf_3 = Isotrim(Surface=item_3, Domain=divide_3)

pt = ConstructPoint(XCoordinate=0, YCoordinate=0, ZCoordinate=0)
pt_2 = ConstructPoint(XCoordinate=7.5, YCoordinate=13, ZCoordinate=0)
# quartz
pt_3 = ConstructPoint(XCoordinate=7.5, YCoordinate=4.5, ZCoordinate=12.2)
X = UnitX(Factor=1)
line = LineSDL(Start=pt, Direction=X, Length=15)
end = EndPoints(Curve=line)  # -> Start, End
ln = Line(StartPoint=end.Start, EndPoint=pt_2)
ln_2 = Line(StartPoint=end.End, EndPoint=pt_2)
merge = Merge(Data1=line, Data2=ln, Data3=ln_2)
patch = Patch(Curves=merge, Spans=20, Flexibility=1, Trim=True)
extr = ExtrudePoint(Base=patch, Point=pt_3)
volume = Volume(Geometry=extr)  # -> Volume, Centroid
ln_3 = Line(StartPoint=pt_3, EndPoint=volume.Centroid)
ln_4 = Line(StartPoint=end.Start, EndPoint=volume.Centroid)
ln_5 = Line(StartPoint=end.End, EndPoint=volume.Centroid)
ln_6 = Line(StartPoint=pt_2, EndPoint=volume.Centroid)
merge_2 = Merge(Data1=volume.Centroid, Data2=pt_3, Data3=end.Start, Data4=end.End, Data5=pt_2)
merge_3 = Merge(Data1=ln_3, Data2=ln_4, Data3=ln_5, Data4=ln_6)
sph = Sphere(Base=merge_2, Radius=Slider(2.314, range=1..5))
pipe = Pipe(Curve=merge_3, Radius=Slider(0.51, range=0..1), Caps=0)

# ----
# side1
debrep_2 = DeconstructBrep(Brep=subsrf)  # -> Faces, Edges, Vertices
item_4 = ListItem(List=debrep_2.Vertices, Index=3, Wrap=True)
item_5 = ListItem(List=debrep_2.Vertices, Index=1, Wrap=True)
item_6 = ListItem(List=debrep_2.Vertices, Index=2, Wrap=True)
item_7 = ListItem(List=debrep_2.Vertices, Index=0, Wrap=True)
cull = CullPattern(List=flatten(item_7), CullPattern=[True, True, False, False])
cull_2 = CullPattern(List=flatten(item_6), CullPattern=[False, True, False, True])
cull_3 = CullPattern(List=flatten(item_4), CullPattern=[False, True, False, False])
pdecon = Deconstruct(Point=cull)  # -> XComponent, YComponent, ZComponent
pdecon_2 = Deconstruct(Point=item_5)  # -> XComponent, YComponent, ZComponent
pdecon_3 = Deconstruct(Point=cull_2)  # -> XComponent, YComponent, ZComponent
pdecon_4 = Deconstruct(Point=cull_3)  # -> XComponent, YComponent, ZComponent
pt_4 = ConstructPoint(XCoordinate=pdecon.XComponent, YCoordinate=pdecon.YComponent, ZCoordinate=pdecon.ZComponent)  # -> flatten(Point)
pt_5 = ConstructPoint(XCoordinate=pdecon_2.XComponent, YCoordinate=pdecon_2.YComponent, ZCoordinate=pdecon_2.ZComponent)  # -> flatten(Point)
pt_6 = ConstructPoint(XCoordinate=pdecon_3.XComponent, YCoordinate=pdecon_3.YComponent, ZCoordinate=pdecon_3.ZComponent)
pt_7 = ConstructPoint(XCoordinate=pdecon_4.XComponent, YCoordinate=pdecon_4.YComponent, ZCoordinate=pdecon_4.ZComponent)
split = SplitList(List=pt_4, Index=1)  # -> ListA, ListB
item_8 = ListItem(List=pt_5, Index=0, Wrap=True)
item_9 = ListItem(List=pt_5, Index=2, Wrap=True)
item_10 = ListItem(List=pt_5, Index=1, Wrap=True)
item_11 = ListItem(List=pt_5, Index=3, Wrap=True)
merge_4 = Merge(Data1=pt_7, Data2=pt_6)
weave = Weave(
    Pattern=[0, 1, 2, 3, 4, 5],
    Stream0=split.ListB,
    Stream1=item_10,
    Stream2=item_11,
    Stream3=split.ListA,
    Stream4=item_8,
    Stream5=item_9,
    NullGaps=False)

debrep_3 = DeconstructBrep(Brep=subsrf_2)  # -> Faces, Edges, Vertices
# side 2
item_12 = ListItem(List=debrep_3.Vertices, Index=1, Wrap=True)
item_13 = ListItem(List=debrep_3.Vertices, Index=2, Wrap=True)
cull_4 = CullPattern(List=flatten(item_13), CullPattern=[False, True, False, True])
pdecon_5 = Deconstruct(Point=item_12)  # -> XComponent, YComponent, ZComponent
pt_8 = ConstructPoint(XCoordinate=pdecon_5.XComponent, YCoordinate=pdecon_5.YComponent, ZCoordinate=pdecon_5.ZComponent)  # -> flatten(Point)
item_14 = ListItem(List=pt_8, Index=0, Wrap=True)
item_15 = ListItem(List=pt_8, Index=2, Wrap=True)
item_16 = ListItem(List=pt_8, Index=1, Wrap=True)
item_17 = ListItem(List=pt_8, Index=3, Wrap=True)
pdecon_6 = Deconstruct(Point=cull_4)  # -> XComponent, YComponent, ZComponent
pt_9 = ConstructPoint(XCoordinate=pdecon_6.XComponent, YCoordinate=pdecon_6.YComponent, ZCoordinate=pdecon_6.ZComponent)
weave_2 = Weave(Pattern=[0, 1, 2, 3], Stream0=item_16, Stream1=item_17, Stream2=item_14, Stream3=item_15, NullGaps=False)

# ----
# top
debrep_4 = DeconstructBrep(Brep=subsrf_3)  # -> Faces, Edges, Vertices
item_18 = ListItem(List=debrep_4.Vertices, Index=3, Wrap=True)
pdecon_7 = Deconstruct(Point=item_18)  # -> XComponent, YComponent, ZComponent

split_2 = SplitList(List=weave_2, Index=2)  # -> ListA, ListB
split_3 = SplitList(List=weave, Index=3)  # -> ListA, ListB

# ----
# left to right
# top line
# middle
# bottom
# top, 'z' from left front
merge_5 = Merge(Data1=merge_4, Data2=pt_9)
merge_6 = Merge(Data1=split_3.ListA, Data2=split_2.ListA)
merge_7 = Merge(Data1=split_3.ListB, Data2=split_2.ListB)
pt_10 = ConstructPoint(XCoordinate=pdecon_7.XComponent, YCoordinate=pdecon_7.YComponent, ZCoordinate=pdecon_7.ZComponent)  # -> flatten(Point)

merge_8 = Merge(Data1=extr, Data2=sph, Data3=pipe)
rad = Radians(Degrees=Slider(120, range=0..360))

# ----
# left
number_slider_2 = Slider(0, range=0..360)

# ----
# right
number_slider_3 = Slider(0, range=0..360)

rotate = Rotate(Geometry=merge_8, Angle=rad, Plane=PlaneXY(0, 0, 0))  # -> Geometry, Transform
xz = XZPlane(Origin=Point(0, 0, 0))
rad_2 = Radians(Degrees=Slider(0, range=0..360))
rad_3 = Radians(Degrees=number_slider_3)
yz = YZPlane(Origin=Point(0, 0, 0))
rad_4 = Radians(Degrees=Slider(120, range=0..360))
rotate_2 = Rotate(Geometry=rotate.Geometry, Angle=rad_2, Plane=xz)  # -> Geometry, Transform
rotate_3 = Rotate(Geometry=rotate_2.Geometry, Angle=rad_3, Plane=yz)  # -> Geometry, Transform
rad_5 = Radians(Degrees=number_slider_2)
rad_6 = Radians(Degrees=Slider(0, range=0..360))
yz_2 = YZPlane(Origin=Point(0, 0, 0))
xz_2 = XZPlane(Origin=Point(0, 0, 0))
rotate_4 = Rotate(Geometry=merge_8, Angle=rad_5, Plane=xz_2)  # -> Geometry, Transform
rad_7 = Radians(Degrees=Slider(240, range=0..360))
xy_plane = XYPlane(Origin=Point(0, 0, 0))
rotate_5 = Rotate(Geometry=rotate_4.Geometry, Angle=rad_7, Plane=xy_plane)  # -> Geometry, Transform
X_2 = UnitX(Factor=Slider(15, range=0..100))
rotate_6 = Rotate(Geometry=rotate_3.Geometry, Angle=rad_4, Plane=PlaneXY(0, 0, 0))  # -> Geometry, Transform
rotate_7 = Rotate(Geometry=rotate_5.Geometry, Angle=rad_6, Plane=yz_2)  # -> Geometry, Transform
move = Move(Geometry=rotate_7.Geometry, Motion=X_2)  # -> Geometry, Transform
# structure
merge_9 = Merge(Data1=merge_8, Data2=move.Geometry, Data3=rotate_6.Geometry)
unit_x = UnitX(Factor=Slider(30, range=0..100))
move_2 = Move(Geometry=merge_9, Motion=unit_x)  # -> Geometry, Transform
merge_10 = Merge(Data1=merge_9, Data2=move_2.Geometry)
unit_y = UnitY(Factor=Slider(26, range=0..100))
move_3 = Move(Geometry=merge_10, Motion=unit_y)  # -> Geometry, Transform
merge_11 = Merge(Data1=merge_9, Data2=move_2.Geometry, Data3=move_3.Geometry)
unit_x_2 = UnitX(Factor=Slider(60, range=0..100))
move_4 = Move(Geometry=merge_11, Motion=unit_x_2)  # -> Geometry, Transform
